# Grasshopper definition 11_AncientArchi.gh (Grasshopper 1.0.7)
# Copyright: caDesign
# Copyright: caDesign.cn设计

number_slider = Slider(0.123, range=0..1)
# 拾取一根控制轴线
curve = Curve(<curve referenced from the Rhino model>)
# 开源(内部程序公开)
# 五檁无廊硬山排架_0.1版
# Rhinoceros _5.0
# Grasshopper_0.9.0075
# GhPython 0.6.0.3
# 
# author:richie bao
number_slider_2 = Slider(2.5, range=0..20)
number_slider_3 = Slider(2.1, range=0..20)
number_slider_4 = Slider(1.8, range=0..20)
面宽 = Merge(Data1=number_slider_2, Data2=Slider(2.1, range=0..20), Data3=Slider(2.1, range=0..20))
举架小式 = 举架小式(
    对位轴=curve,
    步架值=Slider(1.543, range=0..5),
    高=Slider(3.1, range=0..5),
    步架数=Slider(2, range=0..5),
    上檐椽高_2=Slider(0.099, range=0..1),
    榉架高="0.5",
    榉架差数="0.2",
    檁半径=number_slider,
    台明高=Slider(0.3, range=0..1))  # -> 基本点, 檁截面, 椽顶线, 椽面, 椽底线, 上檐出, 台明
五檁无廊硬山排架 = 五檁无廊硬山排架(
    三架梁高=Slider(0.411, range=0..1),
    三架梁厚=Slider(0.327, range=0..1),
    五架梁高=Slider(0.489, range=0..1),
    五架梁厚=Slider(0.308, range=0..1),
    面宽=面宽,
    _5or7=Toggle(True),
    对位轴=curve,
    基本点=举架小式.基本点,
    檁截面=举架小式.檁截面,
    椽面=举架小式.椽面,
    上檐出=举架小式.上檐出,
    台明=举架小式.台明,
    檁半径=number_slider,
    瓜柱进深向长度=Slider(0.146, range=0..1),
    瓜柱面宽向长度=Slider(0.097, range=0..1),
    椽宽=Slider(0.099, range=0..1),
    脊垫板厚=Slider(0.063, range=0..1),
    椽距=Slider(0.11, range=0..1),
    柱径=Slider(0.107, range=0..1),
    脊垫板高=Slider(0.3, range=0..1),
    柱础外圆半径=Slider(0.262, range=0..1),
    柱础内圆高=Slider(0.058, range=0..1),
    柱础内圆半径=Slider(0.036, range=0..1),
    枋高=Slider(0.145, range=0..1),
    枋厚=Slider(0.022, range=0..1))  # -> 台明_2, 檁, 梁, 瓜柱, 椽_飞椽, 脊垫板, 柱, 柱础, 枋

# ==== cluster 举架小式: 参考《梁思成全集第六卷》、马炳坚《中国古建筑木作营造技术》建立五檁无廊硬山排架，可以通过多个设置参数调整开间数量和面宽、步架数等参数，初始输入条件为定位的轴线。程序开源，可以查看封装组件内部的具体程序编写流程，但是程序尚未进行系 统梳理，仅以此作为编程设计切入的一个领域，将不断升级和完善程序。
number_slider = Slider(2, range=0..5)
对位轴 = ClusterInput()
line = Line(对位轴)
步架数 = ClusterInput()
number = Number(步架数)
unit_z = UnitZ(Factor=1)
number_slider_2 = Slider(0.177, range=0..1)
檁半径 = ClusterInput()
evaluate_length = EvaluateLength(Curve=line, Length="0.5", Normalized=True)  # -> Point, Tangent, Parameter
榉架高 = ClusterInput()
panel = Panel("0.2")
panel_2 = Panel("0.5")
榉架差数 = ClusterInput()
move = Move(Geometry=evaluate_length.Point, Motion=unit_z)  # -> Geometry, Transform
number_2 = Number(檁半径)
步架值 = ClusterInput()
number_slider_3 = Slider(1.619, range=0..20)
上檐椽高 = Slider(0.1, range=0..1)
上檐椽高_2 = ClusterInput()
line_pt = LinePt(Line=line, Point=move.Geometry)
number_3 = Number(步架值)
清式举架小式 = PythonScript(X=number_3, Start=榉架高, Step=榉架差数, PS=number_2, Count=number)  # -> out, graft(M), MH
# ---------- 清式举架小式: Python ----------
import rhinoscriptsyntax as rs
import math
start=float(Start)
step=float(Step)
count=int(Count)
h=float(X)
ps=float(PS)
lst=[]
st=start
m=[]
m.append(st)
lst.append(st)
for i in range(count-1):
    start+=step
    lst.append(start)
lst.insert(0,0)
ml=[]

for n in lst:
    nm=n*h
    ml.append(nm)
mll=ml.pop()
mllm=mll+(ps-0.032)
ml.append(mllm)
lastone=ml[-1]
mlo=lastone/h
Mu=[]
M=[]
for q in range(len(ml)):
    Mu.append(ml[q])
    M.append(sum(Mu))
    




m=lst
print(m)
m.pop(0)
m.insert(0,st)
m.pop()
m.append(mlo)
print(m)
MH=m
# ---------- end 清式举架小式 ----------
series = Series(Start="1", Step="1", Count=number)
number_4 = Number(上檐椽高_2)
panel_3 = Panel("1")
series_2 = Series(Start=榉架高, Step=榉架差数, Count=number)
multiplication = Multiplication(A=number_3, B=series)
unit_vector = UnitVector(Vector=line)
insert_items = InsertItems(List=series_2, Item=榉架高, Indices="0", Wrap=True)
negative = Negative(Value=multiplication)
entwine = Entwine(Branch00=multiplication, Branch01=negative, FlattenInputs=True)
amplitude = Amplitude(Vector=unit_vector, Amplitude=entwine)
move_2 = Move(Geometry=evaluate_length.Point, Motion=amplitude)  # -> simplify(Geometry), Transform
multiplication_2 = Multiplication(A=number_3, B=清式举架小式.M)  # -> graft(Result)
上檐椽z方向高 = PythonScript(X=number_3, h=number_4, MH=清式举架小式.MH)  # -> out, hL; inputs MH: list
# ---------- 上檐椽z方向高: Python ----------
import rhinoscriptsyntax as rs
import math 
from math import sqrt
X=float(X)
M=MH
M.pop(0)

hlst=[]
print(M)
for n in range(len(M)):
    mn=float(M[n])
    hl=(h*(sqrt(X**2+(mn*X)**2)))/X
    hlst.append(hl)

add=hlst[-1]
hlst.append(add)
hL=hlst
# ---------- end 上檐椽z方向高 ----------
param_viewer = ParamViewer(move_2.Geometry)
number_slider_4 = Slider(2.703, range=0..9)
高 = ClusterInput()
基本点 = ClusterOutput(move_2.Geometry)
number_5 = Number(高)
reverse_list = ReverseList(List=move_2.Geometry)
檁偏移 = PythonScript(X=number_3, h=檁半径, MH=清式举架小式.MH)  # -> out, hL; inputs MH: list
# ---------- 檁偏移: Python ----------
import rhinoscriptsyntax as rs
import math 
from math import sqrt
M=MH
X=float(X)
h=float(h)
m=M
hL=[]
for i in range(len(m)):
    i=float(m[i])
    lst=(h*(sqrt(X**2+(i*X)**2)))/X
    hL.append(lst)
# ---------- end 檁偏移 ----------
graft_tree = GraftTree(Tree=上檐椽z方向高.hL, IncludeEmptyLists=True, IncludeNullItems=True)
list_item = ListItem(List=reverse_list, Index=0, Wrap=True)  # -> flatten(Item)
list_item_2 = ListItem(List=上檐椽z方向高.hL, Index=0, Wrap=True)
subtraction = Subtraction(A=number_5, B=list_item_2)
panel_4 = Panel(上檐椽z方向高.hL)
flip_matrix = FlipMatrix(Data=reverse_list)  # -> simplify(Data)
unit_z_2 = UnitZ(Factor=subtraction)
panel_5 = Panel(檁偏移.hL)
point = Point(evaluate_length.Point)
replace_paths = ReplacePaths(Data=point, Search="{0}", Replace=number)
unit_z_3 = UnitZ(Factor=清式举架小式.M)
panel_6 = Panel(list_item)
merge = Merge(Data1=flip_matrix, Data2=replace_paths)
move_3 = Move(Geometry=merge, Motion=unit_z_2)  # -> Geometry, Transform
move_4 = Move(Geometry=move_3.Geometry, Motion=unit_z_3)  # -> Geometry, Transform
polyline = PolyLine(Vertices=list_item, Closed=False)
multiplication_3 = Multiplication(A=number_5, B="0.2")
panel_7 = Panel(multiplication_3)
上檐椽z方向高_2 = PythonScript(X=number_3, h=number_4)  # -> out, hL
# ---------- 上檐椽z方向高_2: Python ----------
import rhinoscriptsyntax as rs
import math 
from math import sqrt
X=float(X)
h=float(h)
hL=(h*(sqrt(X**2+(0.5*X)**2)))/X
# ---------- end 上檐椽z方向高_2 ----------
sort_along_curve = SortAlongCurve(Points=flatten(move_4.Geometry), Curve=polyline)  # -> Points, Indices
边计算 = PythonScript(X=number_3, h=multiplication_3)  # -> out, hL; same code as 上檐椽z方向高_2
plane_origin = PlaneOrigin(Base=line_pt, Origin=move_4.Geometry)
polyline_2 = PolyLine(Vertices=sort_along_curve.Points, Closed=False)
panel_8 = Panel(number_4)
planar = Planar(Curve=polyline_2)  # -> Planar, Plane, Deviation
circle = Circle(Plane=plane_origin, Radius=number_2)
number_6 = Number(檁偏移.hL)
panel_9 = Panel(边计算.hL)
extend_curve = ExtendCurve(Curve=polyline_2, Type=0, Start=边计算.hL, End=边计算.hL)
param_viewer_2 = ParamViewer(sort_along_curve.Points)
unit_z_4 = UnitZ(Factor=number_6)
offset = Offset(Curve=extend_curve, Distance=number_4, Plane=planar.Plane, Corners=1)
unit_z_5 = UnitZ(Factor=graft_tree)
merge_2 = Merge(Data1=simplify(extend_curve), Data2=simplify(offset))  # -> flatten(Result)
椽底线 = ClusterOutput(extend_curve)
reverse = Reverse(Vector=unit_z_4)  # -> graft(Vector)
椽顶线 = ClusterOutput(offset)
panel_10 = Panel(planar.Planar)
move_5 = Move(Geometry=move_4.Geometry, Motion=unit_z_5)  # -> simplify(Geometry), Transform
multiplication_4 = Multiplication(A=number_5, B="0.1")
addition = Addition(A=multiplication_3, B=multiplication_4)
end_points = EndPoints(Curve=extend_curve)  # -> Start, End
move_6 = Move(Geometry=circle, Motion=reverse)  # -> Geometry, Transform
negative_2 = Negative(Value=multiplication_4)
loft = Loft(Curves=merge_2, Options={Adjust=False, Closed=False, LoftEnds=0, LoftSimp=0, LoftType=0, Rebuild=10, Refit=0.01})
list_item_3 = ListItem(List=reverse_list, Index=0, Wrap=True)
tree_statistics = TreeStatistics(Tree=move_5.Geometry)  # -> Paths, Length, Count
multiplication_5 = Multiplication(A=addition, B="0.8")
unit_vector_2 = UnitVector(Vector=line)
merge_3 = Merge(Data1=end_points.Start, Data2=end_points.End)  # -> graft(Result)
merge_4 = Merge(Data1=multiplication_4, Data2=negative_2)  # -> graft(Result)
椽面 = ClusterOutput(loft)
list_item_4 = ListItem(List=tree_statistics.Paths, Index=0, Wrap=True)
檁截面 = ClusterOutput(move_6.Geometry)
polyline_3 = PolyLine(Vertices=flatten(list_item_3), Closed=False)
amplitude_2 = Amplitude(Vector=unit_vector_2, Amplitude=merge_4)
number_slider_5 = Slider(0.358, range=0..1)
台明高 = ClusterInput()
end_points_2 = EndPoints(Curve=offset)  # -> Start, End
extend_curve_2 = ExtendCurve(Curve=polyline_3, Type=0, Start=multiplication_5, End=multiplication_5)
move_7 = Move(Geometry=merge_3, Motion=amplitude_2)  # -> Geometry, Transform
tree_branch = TreeBranch(Tree=move_5.Geometry, Path=list_item_4, MaintainPaths=True)  # -> graft(Branch)
merge_5 = Merge(Data1=end_points_2.Start, Data2=end_points_2.End)  # -> graft(Result)
negative_3 = Negative(Value=台明高)
offset_2 = Offset(Curve=extend_curve_2, Distance=negative_3, Plane=line_pt, Corners=1)
number_7 = Number(number_4)
negative_4 = Negative(Value=number_7)
merge_6 = Merge(Data1=extend_curve_2, Data2=offset_2)  # -> flatten(Result)
plane_origin_2 = PlaneOrigin(Base=line_pt, Origin=merge_5)
merge_7 = Merge(Data1=negative_4, Data2=number_7)  # -> graft(Result)
loft_2 = Loft(
    Curves=flatten(merge_6),
    Options={Adjust=False, Closed=False, LoftEnds=0, LoftSimp=0, LoftType=0, Rebuild=10, Refit=0.01})
台明 = ClusterOutput(loft_2)
param_viewer_3 = ParamViewer(merge_7)
line_2 = Line(StartPoint=merge_5, EndPoint=move_7.Geometry)
offset_3 = Offset(Curve=line_2, Distance=merge_7, Plane=plane_origin_2, Corners=1)
end_points_3 = EndPoints(Curve=offset_3)  # -> Start, End
line_3 = Line(StartPoint=tree_branch, EndPoint=merge_5)
line_4 = Line(StartPoint=end_points_3.End, EndPoint=move_7.Geometry)
line_5 = Line(StartPoint=tree_branch, EndPoint=end_points_3.End)
merge_8 = Merge(Data1=line_3, Data2=line_5, Data3=line_2, Data4=line_4)  # -> flatten(Result)
panel_11 = Panel(merge_8)
join_curves = JoinCurves(Curves=merge_8, Preserve=False)
fragment_patch = FragmentPatch(Boundary=join_curves)
panel_12 = Panel(join_curves)
上檐出 = ClusterOutput(fragment_patch)

# ==== cluster 五檁无廊硬山排架: 参考《梁思成全集第六卷》、马炳坚《中国古建筑木作营造技术》建立五檁无廊硬山排架，可以通过多个设置参数调整开间数量和面宽、步架数等参数，初始输入条件为定位的轴线。程序开源，可以查看封装组件内部的具体程序编写流程，但是程序尚未进行系 统梳理，仅以此作为编程设计切入的一个领域，将不断升级和完善程序。
对位轴 = ClusterInput()
基本点 = ClusterInput()
台明 = ClusterInput()
上檐出 = ClusterInput()
椽面 = ClusterInput()
檁半径 = ClusterInput()
檁截面 = ClusterInput()
boolean_toggle = BooleanToggle(False)
_5or7 = ClusterInput()
椽距 = ClusterInput()
number_slider = Slider(0.11, range=0..1)
number_slider_2 = Slider(0.099, range=0..1)
椽宽 = ClusterInput()
number_slider_3 = Slider(0.322, range=0..1)
surface = Surface(椽面)
division = Division(A=椽宽, B="2")
negative = Negative(Value=division)
addition = Addition(A=椽宽, B=椽距)
surface_2 = Surface(上檐出)
multiplication = Multiplication(A=椽宽, B="2")
division_2 = Division(A=椽宽, B="2")
merge = Merge(Data1=division, Data2=negative)  # -> graft(Result)
negative_2 = Negative(Value=division_2)
param_viewer = ParamViewer(椽宽)
merge_2 = Merge(Data1=division_2, Data2=negative_2)  # -> graft(Result)
offset = Offset(Surface=flatten(surface), Distance=merge, Retrim=True)
panel = Panel(multiplication)
offset_2 = Offset(Surface=flatten(surface_2), Distance=merge_2, Retrim=True)
flip_matrix = FlipMatrix(Data=offset)
loft = Loft(Curves=flip_matrix, Options={Adjust=False, Closed=False, LoftEnds=0, LoftSimp=0, LoftType=0, Rebuild=10, Refit=0.01})
merge_3 = Merge(Data1=offset, Data2=loft)  # -> flatten(Result)
flip_matrix_2 = FlipMatrix(Data=offset_2)
loft_2 = Loft(Curves=flip_matrix_2, Options={Adjust=False, Closed=False, LoftEnds=0, LoftSimp=0, LoftType=0, Rebuild=10, Refit=0.01})
merge_4 = Merge(Data1=offset_2, Data2=loft_2)  # -> flatten(Result)
number_slider_4 = Slider(0.25, range=0..1)
brep_join = BrepJoin(Breps=merge_3)  # -> Breps, Closed
brep_join_2 = BrepJoin(Breps=merge_4)  # -> Breps, Closed
negative_3 = Negative(Value=number_slider_4)
merge_5 = Merge(Data1=number_slider_4, Data2=negative_3)
reverse_list = ReverseList(List=基本点)
evaluate_length = EvaluateLength(Curve=对位轴, Length="0.5", Normalized=True)  # -> Point, Tangent, Parameter
offset_3 = Offset(Curve=对位轴, Distance=merge_5, Plane=PlaneXY(0, 0, 0), Corners=1)
list_item = ListItem(List=reverse_list, Index=0, Wrap=True)
param_viewer_2 = ParamViewer(brep_join_2.Breps)
merge_6 = Merge(Data1=brep_join.Breps, Data2=brep_join_2.Breps)  # -> flatten(Result)
group = Group(Objects=merge_6)
evaluate_length_2 = EvaluateLength(Curve=offset_3, Length="0.5", Normalized=True)  # -> Point, Tangent, Parameter
flatten_tree = FlattenTree(Tree=檁截面, Path="{0}")
vector_2pt = Vector2Pt(PointA=evaluate_length.Point, PointB=evaluate_length_2.Point, Unitize=False)  # -> Vector, Length
unit_vector = UnitVector(Vector=vector_2pt.Vector)
unit_vector_2 = UnitVector(Vector=vector_2pt.Vector)
面宽 = ClusterInput()
unit_vector_3 = UnitVector(Vector=vector_2pt.Vector)
group_2 = Group(Objects=flatten_tree)
unit_vector_4 = UnitVector(Vector=vector_2pt.Vector)
flatten_tree_2 = FlattenTree(Tree=台明, Path="{0}")
flatten_tree_3 = FlattenTree(Tree=list_item, Path="{0}")
group_3 = Group(Objects=flatten_tree_3)
list_item_2 = ListItem(List=面宽, Index="0", Wrap=True)
param_viewer_3 = ParamViewer(vector_2pt.Vector)
division_3 = Division(A=list_item_2, B="2")
panel_2 = Panel(flatten_tree_2)
mv = PythonScript(KJ=面宽)  # -> out, OffsetD; inputs KJ: list
# ---------- mv: Python ----------
import rhinoscriptsyntax as rs
import math
lst=[]
od=[]
ko=KJ.pop(0)
print(ko)
KJ.insert(0,ko/2)
for i in KJ:
    lst.append(i)
    od.append(sum(lst))
    
OffsetD=od
# ---------- end mv ----------
replace_items = ReplaceItems(List=面宽, Item=division_3, Indices="0", Wrap=False)
mass_addition = MassAddition(Input=replace_items)  # -> Result, PartialResults
division_4 = Division(A=mass_addition.Result, B=addition)
round = Round(Number=division_4)  # -> Nearest, Floor, Ceiling
series = Series(Start=addition, Step=addition, Count=round.Ceiling)
amplitude = Amplitude(Vector=unit_vector, Amplitude=series)
move = Move(Geometry=group, Motion=amplitude)  # -> Geometry, Transform
mass_addition_2 = MassAddition(Input=replace_items)  # -> Result, PartialResults
merge_7 = Merge(Data1=merge_6, Data2=move.Geometry)
addition_2 = Addition(A=mass_addition_2.Result, B=Slider(0.506, range=0..1))
amplitude_2 = Amplitude(Vector=unit_vector_3, Amplitude=addition_2)
椽_飞椽 = ClusterOutput(merge_7)
move_2 = Move(Geometry=flatten_tree_2, Motion=amplitude_2)  # -> Geometry, Transform
list_length = ListLength(List=面宽)  # -> flatten(Length)
entwine = Entwine(Branch00=mv.OffsetD, Branch01=mv.OffsetD, FlattenInputs=True)
amplitude_3 = Amplitude(Vector=unit_vector_2, Amplitude=entwine)
amplitude_4 = Amplitude(Vector=unit_vector_4, Amplitude=entwine)
move_3 = Move(Geometry=group_2, Motion=amplitude_4)  # -> Geometry, Transform
move_4 = Move(Geometry=group_3, Motion=amplitude_3)  # -> Geometry, Transform
ungroup = Ungroup(Group=move_4.Geometry)
ungroup_2 = Ungroup(Group=move_3.Geometry)  # -> simplify(Objects)
area = Area(Geometry=ungroup_2)  # -> Area, Centroid
tree_statistics = TreeStatistics(Tree=ungroup_2)  # -> Paths, Length, Count
list_length_2 = ListLength(List=tree_statistics.Paths)
loft_3 = Loft(
    Curves=flatten(move_2.Geometry),
    Options={Adjust=False, Closed=False, LoftEnds=0, LoftSimp=0, LoftType=0, Rebuild=10, Refit=0.01})
subtraction = Subtraction(A=list_length, B="1")
subtraction_2 = Subtraction(A=list_length_2, B="1")
panel_3 = Panel("""0
1""")
cull_index = CullIndex(List=area.Centroid, Indices=panel_3, Wrap=True)
panel_4 = Panel(replace_items)
台明_2 = ClusterOutput(loft_3)
panel_6 = Panel("""1
2
2
2
2
2""")
reverse_list_2 = ReverseList(List=cull_index)
merge_8 = Merge(Data1=subtraction_2, Data2=subtraction)
partition_list = PartitionList(List=reverse_list_2, Size=panel_6)  # -> simplify(Chunks)
list_item_3 = ListItem(List=area.Centroid, Index=panel_3, Wrap=True)
panel_7 = Panel(loft_3)
list_item_4 = ListItem(List=tree_statistics.Paths, Index=merge_8, Wrap=True)
line = Line(StartPoint=ungroup, EndPoint=list_item_3)
reverse_list_3 = ReverseList(List=area.Centroid)
tree_branch = TreeBranch(Tree=ungroup_2, Path=list_item_4, MaintainPaths=True)  # -> simplify(Branch)
polyline = PolyLine(Vertices=list_item_3, Closed=False)
cull_index_2 = CullIndex(List=reverse_list_3, Indices="0", Wrap=True)
point_list = PointList(Points=flatten(partition_list), Tags=True, Lines=True, Size=Slider(0.25, range=0..1))
number_slider_5 = Slider(0.076, range=0..1)
flip_matrix_3 = FlipMatrix(Data=tree_branch)
partition_list_2 = PartitionList(List=cull_index_2, Size="2")  # -> simplify(Chunks)
polyline_2 = PolyLine(Vertices=partition_list_2, Closed=False)
curve = Curve(polyline_2)
curve_closest_point = CurveClosestPoint(Point=partition_list, Curve=curve)  # -> Point, Parameter, Distance
number_slider_6 = Slider(0.275, range=0..1)
polyline_3 = PolyLine(Vertices=flip_matrix_3, Closed=False)
line_2 = Line(StartPoint=partition_list, EndPoint=curve_closest_point.Point)  # -> simplify(Line)
path_mapper = PathMapper(line_2, source="{A;B;C}", target="{C}")
tree_statistics_2 = TreeStatistics(Tree=path_mapper)  # -> Paths, Length, Count
subtraction_3 = Subtraction(A=tree_statistics_2.Count, B="1")
construct_path = ConstructPath(Indices=subtraction_3)
panel_8 = Panel(construct_path)
tree_branch_2 = TreeBranch(Tree=path_mapper, Path=construct_path, MaintainPaths=True)
end_points = EndPoints(Curve=tree_branch_2)  # -> Start, End
point = Point(end_points.End)
brep_closest_point = BrepClosestPoint(Point=end_points.Start, Brep=loft_3)  # -> Point, Distance
line_3 = Line(StartPoint=end_points.Start, EndPoint=brep_closest_point.Point)
number_slider_7 = Slider(0.171, range=0..1)
param_viewer_4 = ParamViewer(brep_closest_point.Point)
path_mapper_2 = PathMapper(line_2, source="{A;B;C}(i)", target="{item_count)")
panel_9 = Panel(brep_closest_point.Point)
unit_z = UnitZ(Factor=1)
param_viewer_5 = ParamViewer(line_3)
multiplication_2 = Multiplication(A=檁半径, B="0.5")
pipe = Pipe(Curve=line_3, Radius=Slider(0.117, range=0..1), Caps=0)
partition_list_3 = PartitionList(List=line_3, Size="2")
extend_curve = ExtendCurve(Curve=polyline_3, Type=0, Start=number_slider_7, End=number_slider_7)
reverse = Reverse(Vector=unit_z)
number_slider_8 = Slider(0.146, range=0..1)
number_slider_9 = Slider(0.097, range=0..1)
瓜柱面宽向长度 = ClusterInput()
瓜柱进深向长度 = ClusterInput()
param_viewer_6 = ParamViewer(list_item_3)
curve_2 = Curve(extend_curve)
perp_frame = PerpFrame(Curve=path_mapper_2, Parameter="0")
pipe_2 = Pipe(Curve=extend_curve, Radius=檁半径, Caps=0)
unit_z_2 = UnitZ(Factor=multiplication_2)
subtraction_4 = Subtraction(A=Slider(0.338, range=0..1), B=multiplication_2)
loft_4 = Loft(
    Curves=partition_list_3,
    Options={Adjust=False, Closed=False, LoftEnds=0, LoftSimp=0, LoftType=0, Rebuild=10, Refit=0.01})
list_length_3 = ListLength(List=flatten(loft_4))
number_slider_10 = Slider(0.411, range=0..1)
number_slider_11 = Slider(0.489, range=0..1)
number_slider_12 = Slider(0.877, range=0..1)
negative_4 = Negative(Value=subtraction_4)
tree_branch_3 = TreeBranch(Tree=path_mapper_2, Path="{1}", MaintainPaths=True)
partition_list_4 = PartitionList(List=flatten(curve_2), Size="2")  # -> simplify(Chunks)
reverse_list_4 = ReverseList(List=flatten(extend_curve))
五架梁高 = ClusterInput()
三架梁高 = ClusterInput()
point_on_curve = PointOnCurve(curve_2, parameter=0.473)
number_slider_13 = Slider(0.3, range=0..1)
loft_5 = Loft(Curves=flatten(loft_4), Options={Adjust=False, Closed=False, LoftEnds=0, LoftSimp=0, LoftType=0, Rebuild=10, Refit=0.01})
negative_5 = Negative(Value=number_slider_12)
unit_z_3 = UnitZ(Factor=negative_4)
cap_holes = CapHoles(Brep=pipe_2)
脊垫板高 = ClusterInput()
cull_index_3 = CullIndex(List=flatten(reverse_list_4), Indices="0", Wrap=True)
partition_list_5 = PartitionList(List=cull_index_3, Size="2")
param_viewer_7 = ParamViewer(path_mapper_2)
move_5 = Move(Geometry=polyline_2, Motion=unit_z_2)  # -> Geometry, Transform
subtraction_5 = Subtraction(A=list_length_3, B="1")
merge_9 = Merge(Data1="0", Data2=subtraction_5)
檁 = ClusterOutput(cap_holes)
crectangle = PythonScript(CPlane=perp_frame, x=瓜柱进深向长度, y=瓜柱面宽向长度)  # -> out, Rectangle
# ---------- crectangle: Python ----------
import rhinoscriptsyntax as rs
x=float(x)
y=float(y)
v=-x/2
w=-y/2

CP=CPlane
rectangleo=rs.AddRectangle(CP, x, y )
sc=rs.CurveAreaCentroid(rectangleo)
scp=rs.AddPoint(sc[0])
cpe=rs.EvaluatePlane(CP,(0,0))
cpp=rs.AddPoint(cpe)
trans=rs.VectorCreate(cpp,scp)
rectangle=rs.MoveObject(rectangleo,trans)
Rectangle=rectangle
# ---------- end crectangle ----------
param_viewer_8 = ParamViewer(polyline_2)
number_slider_14 = Slider(8.691, range=0..20)
merge_10 = Merge(Data1=negative_5, Data2=number_slider_12)  # -> graft(Result)
list_item_5 = ListItem(List=flatten(loft_4), Index="0", Wrap=True)
multiplication_3 = Multiplication(A=檁半径, B="2")
merge_11 = Merge(Data1=三架梁高, Data2=五架梁高)  # -> graft(Result)
flip_matrix_4 = FlipMatrix(Data=partition_list_5)
unit_vector_5 = UnitVector(Vector=list_item_5)
move_6 = Move(Geometry=polyline, Motion=unit_z_3)  # -> Geometry, Transform
negative_6 = Negative(Value=number_slider_14)
point_on_curve_2 = PointOnCurve(cull_index_3, parameter=0.5)
subtraction_6 = Subtraction(A=merge_11, B=multiplication_2)  # -> graft(Result)
number = Number(subtraction_6)
reverse_list_5 = ReverseList(List=flatten(number))
merge_12 = Merge(Data1=flatten(reverse_list_5), Data2=脊垫板高)  # -> simplify(graft(Result))
unit_z_4 = UnitZ(Factor=merge_12)
param_viewer_9 = ParamViewer(crectangle.Rectangle)
offset_4 = Offset(Curve=flip_matrix_4, Distance=merge_10, Plane=PlaneXY(0, 0, 0), Corners=1)
extend_curve_2 = ExtendCurve(Curve=move_5.Geometry, Type=0, Start=multiplication_3, End=multiplication_3)  # -> simplify(Curve)
param_viewer_10 = ParamViewer(move_5.Geometry)
point_list_2 = PointList(Points=flatten(point_on_curve), Tags=True, Lines=True, Size=Slider(0.25, range=0..1))
sweep1 = Sweep1(Rail=graft(path_mapper_2), Sections=graft(crectangle.Rectangle), Miter=1)
number_slider_15 = Slider(0.063, range=0..1)
negative_7 = Negative(Value=subtraction_6)
panel_10 = Panel(subtraction_6)
reverse_2 = Reverse(Vector=unit_z_4)
merge_13 = Merge(Data1=number_slider_14, Data2=negative_6)
amplitude_5 = Amplitude(Vector=unit_vector_5, Amplitude=merge_13)
graft_tree = GraftTree(Tree=flip_matrix_4, IncludeEmptyLists=True, IncludeNullItems=True)
point_list_3 = PointList(Points=point_on_curve_2, Tags=True, Lines=True, Size=Slider(0.663, range=0..1))
param_viewer_11 = ParamViewer(loft_4)
path_mapper_3 = PathMapper(offset_4, source="{A;B;C;D}", target="{A;B;C}")
number_slider_16 = Slider(0.145, range=0..1)
path_mapper_4 = PathMapper(extend_curve_2, source="{A;B;C}", target="{C}")
枋高 = ClusterInput()
unit_z_5 = UnitZ(Factor=negative_7)
move_7 = Move(Geometry=path_mapper_4, Motion=unit_z_5)  # -> simplify(Geometry), Transform
panel_11 = Panel(merge_12)
cap_holes_2 = CapHoles(Brep=sweep1)
number_slider_17 = Slider(0.25, range=0..1)
瓜柱 = ClusterOutput(sweep1)
merge_14 = Merge(Data1=graft_tree, Data2=offset_4)
move_8 = Move(Geometry=partition_list_4, Motion=reverse_2)  # -> Geometry, Transform
脊垫板厚 = ClusterInput()
trim_solid = TrimSolid()
panel_12 = Panel(loft_4)
extrude = Extrude(Base=list_item_5, Direction=amplitude_5)
volume = Volume(Geometry=extrude)  # -> Volume, Centroid
scale_nu = ScaleNU(
    Geometry=extrude,
    Plane=volume.Centroid,
    ScaleX=Slider(1, range=0..2),
    ScaleY=Slider(1.23, range=0..2),
    ScaleZ=Slider(0.68, range=0..2))  # -> Geometry, Transform
param_viewer_12 = ParamViewer(scale_nu.Geometry)
extrude_2 = Extrude(Base=partition_list_4, Direction=reverse_2)
negative_8 = Negative(Value=脊垫板厚)
match_tree = MatchTree(Tree=move_7.Geometry, Guide=path_mapper_4)
param_viewer_13 = ParamViewer(path_mapper_4)
loft_6 = Loft(Curves=merge_14, Options={Adjust=False, Closed=False, LoftEnds=0, LoftSimp=0, LoftType=0, Rebuild=10, Refit=0.01})
unit_z_6 = UnitZ(Factor=枋高)
unit_z_7 = UnitZ(Factor=1)
merge_15 = Merge(Data1=脊垫板厚, Data2=negative_8)  # -> graft(Result)
merge_16 = Merge(Data1=graft(path_mapper_4), Data2=graft(match_tree))
param_viewer_14 = ParamViewer(match_tree)
param_viewer_15 = ParamViewer(move_8.Geometry)
reverse_3 = Reverse(Vector=unit_z_6)
move_9 = Move(Geometry=move_8.Geometry, Motion=reverse_3)  # -> Geometry, Transform
number_slider_18 = Slider(0.308, range=0..1)
number_slider_19 = Slider(0.327, range=0..1)
五架梁厚 = ClusterInput()
三架梁厚 = ClusterInput()
offset_5 = Offset(Surface=flatten(extrude_2), Distance=merge_15, Retrim=True)
extrude_3 = Extrude(Base=loft_6, Direction=unit_z_7)  # -> flatten(Extrusion)
loft_7 = Loft(Curves=merge_16, Options={Adjust=False, Closed=False, LoftEnds=0, LoftSimp=0, LoftType=0, Rebuild=10, Refit=0.01})
list_item_6 = ListItem(List=param_viewer_15, Index=0, Wrap=True)
number_slider_20 = Slider(0.022, range=0..1)
枋厚 = ClusterInput()
flip_matrix_5 = FlipMatrix(Data=offset_5)
path_mapper_5 = PathMapper(loft_7, source="{A;B}", target="{A}")
extrude_4 = Extrude(Base=move_8.Geometry, Direction=reverse_3)
merge_17 = Merge(Data1=三架梁厚, Data2=五架梁厚)
negative_9 = Negative(Value=枋厚)
division_5 = Division(A=merge_17, B="2")  # -> graft(Result)
param_viewer_16 = ParamViewer(extrude_3)
tree_branch_4 = TreeBranch(Tree=move_8.Geometry, Path=list_item_6, MaintainPaths=True)
loft_8 = Loft(Curves=flip_matrix_5, Options={Adjust=False, Closed=False, LoftEnds=0, LoftSimp=0, LoftType=0, Rebuild=10, Refit=0.01})
line_4 = Line(simplify(flatten(line)))
merge_18 = Merge(Data1=offset_5, Data2=loft_8)  # -> flatten(Result)
merge_19 = Merge(Data1=枋厚, Data2=negative_9)  # -> graft(Result)
negative_10 = Negative(Value=division_5)
param_viewer_17 = ParamViewer(tree_branch_4)
offset_6 = Offset(Surface=flatten(extrude_4), Distance=merge_19, Retrim=True)
end_points_2 = EndPoints(Curve=line_4)  # -> Start, End
brep_join_3 = BrepJoin(Breps=merge_18)  # -> Breps, Closed
number_slider_21 = Slider(0.262, range=0..1)
merge_20 = Merge(Data1=end_points_2.Start, Data2=brep_closest_point.Point)  # -> flatten(Result)
line_line = LineLine(Line1=line_4, Line2=tree_branch_4)  # -> ParamA, ParamB, PointA, PointB
offset_7 = Offset(Surface=path_mapper_5, Distance=division_5, Retrim=True)
offset_8 = Offset(Surface=path_mapper_5, Distance=negative_10, Retrim=True)
柱础外圆半径 = ClusterInput()
脊垫板 = ClusterOutput(brep_join_3.Breps)
flip_matrix_6 = FlipMatrix(Data=offset_6)
loft_9 = Loft(Curves=flip_matrix_6, Options={Adjust=False, Closed=False, LoftEnds=0, LoftSimp=0, LoftType=0, Rebuild=10, Refit=0.01})
stream_filter = StreamFilter(Gate=_5or7, Stream0=merge_20, Stream1=end_points_2.Start)
param_viewer_18 = ParamViewer(brep_join_3.Breps)
number_slider_22 = Slider(0.107, range=0..1)
line_5 = Line(StartPoint=line_line.PointA, EndPoint=end_points_2.Start)
merge_21 = Merge(Data1=offset_6, Data2=loft_9)  # -> flatten(Result)
merge_22 = Merge(Data1=graft(offset_7), Data2=graft(offset_8))
param_viewer_19 = ParamViewer(line_line.PointB)
number_slider_23 = Slider(0.058, range=0..1)
柱础内圆高 = ClusterInput()
柱径 = ClusterInput()
loft_10 = Loft(Curves=merge_22, Options={Adjust=False, Closed=False, LoftEnds=0, LoftSimp=0, LoftType=0, Rebuild=10, Refit=0.01})
cap_holes_3 = CapHoles(Brep=loft_10)
circle = Circle(Plane=stream_filter, Radius=柱础外圆半径)
brep_join_4 = BrepJoin(Breps=merge_21)  # -> Breps, Closed
pipe_3 = Pipe(Curve=line_5, Radius=柱径, Caps=0)
unit_z_8 = UnitZ(Factor=柱础内圆高)
number_slider_24 = Slider(0.036, range=0..1)
柱础内圆半径 = ClusterInput()
枋 = ClusterOutput(brep_join_4.Breps)
param_viewer_20 = ParamViewer(brep_join_4.Breps)
panel_13 = Panel(cap_holes_3)
move_10 = Move(Geometry=merge_20, Motion=unit_z_8)  # -> Geometry, Transform
cap_holes_4 = CapHoles(Brep=pipe_3)
subtraction_7 = Subtraction(A=柱础外圆半径, B=柱础内圆半径)
solid_difference = SolidDifference(BrepsA=cap_holes_3, BrepsB=extrude_3)
solid_difference_2 = SolidDifference(BrepsA=flatten(solid_difference), BrepsB=flatten(scale_nu.Geometry))
merge_23 = Merge(Data1=pipe, Data2=cap_holes_4)
circle_2 = Circle(Plane=move_10.Geometry, Radius=subtraction_7)
merge_24 = Merge(Data1=graft(circle), Data2=graft(circle_2))
stream_filter_2 = StreamFilter(Gate=_5or7, Stream0=merge_23, Stream1=cap_holes_4)
stream_filter_3 = StreamFilter(Gate=_5or7, Stream0=solid_difference_2, Stream1=solid_difference)
梁 = ClusterOutput(stream_filter_3)
柱 = ClusterOutput(stream_filter_2)
loft_11 = Loft(Curves=merge_24, Options={Adjust=False, Closed=False, LoftEnds=0, LoftSimp=0, LoftType=0, Rebuild=10, Refit=0.01})
param_viewer_21 = ParamViewer(merge_24)
param_viewer_22 = ParamViewer(cap_holes_3)
cap_holes_5 = CapHoles(Brep=loft_11)
柱础 = ClusterOutput(cap_holes_5)
