# Grasshopper definition 44_architecture_fish.gh (Grasshopper 0.9.76)

曲线 = 曲线()
截面扫描 = 截面扫描()
截面长 = 截面长()
crv = Curve([<curve referenced from the Rhino model> x6])
截面宽 = 截面宽()
negative = Negative(Value=截面长)
negative_2 = Negative(Value=截面宽)
正垂直曲线参考平面 = 正垂直曲线参考平面(曲线=曲线)
point_on_curve = PointOnCurve(crv, parameter=0.5)
construct_domain = ConstructDomain(DomainStart=截面宽, DomainEnd=negative_2)
construct_domain_2 = ConstructDomain(DomainStart=截面长, DomainEnd=negative)
# A
# A
# B
# C
# D
# E
# F
explode_tree = ExplodeTree(Data=graft(crv))  # -> Branch0, Branch1, Branch2, Branch3, Branch4, Branch5
rectangle = Rectangle(Plane=正垂直曲线参考平面, XSize=construct_domain, YSize=construct_domain_2, Radius=0)  # -> Rectangle, Length
point_list = PointList(Points=point_on_curve, Size=Slider(0.899, range=0..3))
sweep1 = Sweep1(Rail=曲线, Sections=rectangle.Rectangle, Miter=1)
截面扫描_2 = 截面扫描(曲线=explode_tree.Branch2, 截面宽=Slider(0.384, range=0..1), 截面长=Slider(0.132, range=0..1))
cap_holes = CapHoles(Brep=sweep1)
截面扫描_3 = 截面扫描(cap_holes)
# D
curve = Curve(explode_tree.Branch3)
# E
curve_2 = Curve(explode_tree.Branch4)
# D
curve_3 = Curve(explode_tree.Branch3)
# C
curve_4 = Curve(explode_tree.Branch2)
# J
number_slider = Slider(12, range=0..30)
# D
curve_5 = Curve(explode_tree.Branch3)
# E
curve_6 = Curve(explode_tree.Branch4)
# A
curve_7 = Curve(explode_tree.Branch0)
# C
curve_8 = Curve(explode_tree.Branch2)
# B
curve_9 = Curve(explode_tree.Branch1)

# ----
# F
curve_10 = Curve(explode_tree.Branch5)
# C
curve_11 = Curve(explode_tree.Branch2)
end_points = EndPoints(Curve=curve_10)  # -> Start, End
curve_closest_point = CurveClosestPoint(Point=end_points.End, Curve=curve_11)  # -> Point, Parameter, Distance
line = Line(StartPoint=end_points.End, EndPoint=curve_closest_point.Point)
shatter = Shatter(Curve=curve_11, Parameters=curve_closest_point.Parameter)
flip_curve = FlipCurve(Curve=curve_10)  # -> Curve, Flag
list_item = ListItem(List=shatter, Index="1", Wrap=True)
sweep2 = Sweep2(Rail1=list_item, Rail2=flip_curve.Curve, Sections=line, SameHeight=False)

# ----
# D
curve_12 = Curve(explode_tree.Branch3)
# E
curve_13 = Curve(explode_tree.Branch4)

# ----
# J
multiplication = Multiplication(A=number_slider, B=Slider(8, range=0..30))
divide_curve = DivideCurve(Curve=curve_12, Count=multiplication, Kinks=False)  # -> simplify(graft(Points)), Tangents, Parameters
horizontal_frame = HorizontalFrame(Curve=curve_12, Parameter=divide_curve.Parameters)
deconstruct_plane = DeconstructPlane(Plane=horizontal_frame)  # -> Origin, XAxis, YAxis, ZAxis
unit_vector = UnitVector(Vector=horizontal_frame)
construct_plane = ConstructPlane(Origin=deconstruct_plane.Origin, XAxis=unit_vector, YAxis=deconstruct_plane.YAxis)
curve_plane = CurvePlane(Curve=curve_13, Plane=construct_plane)  # -> simplify(Points), ParamsC, ParamsP
line_2 = Line(StartPoint=curve_plane.Points, EndPoint=divide_curve.Points)
截面扫描_4 = 截面扫描(曲线=line_2, 截面宽=Slider(0.068, range=0..1), 截面长=Slider(0.033, range=0..1))  # -> graft(截面扫描)

flip_curve_2 = FlipCurve(Curve=curve_7)  # -> Curve, Flag
merge = Merge(Data1=flip_curve_2.Curve, Data2=curve_9)  # -> flatten(Result)
divide_curve_2 = DivideCurve(Curve=curve_5, Count=number_slider, Kinks=False)  # -> simplify(graft(Points)), Tangents, Parameters
divide_curve_3 = DivideCurve(Curve=curve_8, Count=number_slider, Kinks=False)  # -> simplify(graft(Points)), Tangents, Parameters
horizontal_frame_2 = HorizontalFrame(Curve=curve_5, Parameter=divide_curve_2.Parameters)
loft = Loft(Curves=merge, Options={Adjust=False, Closed=False, LoftEnds=0, LoftSimp=0, LoftType=0, Rebuild=10, Refit=0.01})
deconstruct_plane_2 = DeconstructPlane(Plane=horizontal_frame_2)  # -> Origin, XAxis, YAxis, ZAxis
unit_vector_2 = UnitVector(Vector=horizontal_frame_2)
construct_plane_2 = ConstructPlane(Origin=deconstruct_plane_2.Origin, XAxis=unit_vector_2, YAxis=deconstruct_plane_2.YAxis)
curve_plane_2 = CurvePlane(Curve=curve_6, Plane=construct_plane_2)  # -> simplify(Points), ParamsC, ParamsP
merge_2 = Merge(Data1=divide_curve_3.Points, Data2=divide_curve_2.Points, Data3=curve_plane_2.Points)
cull_duplicates = CullDuplicates(Points=merge_2, Tolerance=0.1, CullMode=3)  # -> Points, Indices, Valence
polyline = PolyLine(Vertices=cull_duplicates.Points, Closed=False)  # -> simplify(Polyline)
explode = Explode(Curve=polyline, Recursive=True)  # -> Segments, Vertices
list_length = ListLength(List=explode.Segments)
equality = Equality(FirstNumber=list_length, SecondNumber="2")  # -> flatten(Equality), Inequality
tree_statistics = TreeStatistics(Tree=explode.Segments)  # -> Paths, Length, Count
cull_pattern = CullPattern(List=tree_statistics.Paths, CullPattern=equality.Equality)
tree_branch = TreeBranch(Tree=explode.Segments, Path=cull_pattern, MaintainPaths=True)

flip_curve_3 = FlipCurve(Curve=curve_2)  # -> Curve, Flag
number_slider_2 = Slider(1, range=0..1)
# G
panel = Panel("1")
list_item_2 = ListItem(List=tree_branch, Index=panel, Wrap=True)  # -> flatten(Item)
ruled_surface = RuledSurface(CurveA=curve, CurveB=flip_curve_3.Curve)
negative_3 = Negative(Value=number_slider_2)
length = Length(Curve=list_item_2)
sort_list = SortList(Keys=length, ValuesValuesA=list_item_2)  # -> Keys, ValuesValuesA
merge_3 = Merge(Data1=number_slider_2, Data2=negative_3)
reverse_list = ReverseList(List=sort_list.ValuesValuesA)
list_item_3 = ListItem(List=reverse_list, Index="0", Wrap=True)
divide_curve_4 = DivideCurve(Curve=list_item_3, Count=Slider(3, range=0..5), Kinks=False)  # -> Points, Tangents, Parameters
list_item_4 = ListItem(List=divide_curve_4.Points, Index="1", Wrap=True)
list_item_5 = ListItem(List=divide_curve_4.Points, Index="0", Wrap=True)
distance = Distance(PointA=list_item_5, PointB=list_item_4)
series = Series(Start=distance, Step=distance, Count=Slider(2, range=0..5))
unit_z = UnitZ(Factor=series)
move = Move(Geometry=curve_2, Motion=unit_z)  # -> graft(Geometry), Transform
offset = Offset(Curve=move.Geometry, Distance=merge_3, Plane=PlaneXY(0, 0, 0), Corners=1)
trim_tree = TrimTree(Tree=offset, Depth="1")
loft_2 = Loft(Curves=trim_tree, Options={Adjust=False, Closed=False, LoftEnds=0, LoftSimp=0, LoftType=0, Rebuild=10, Refit=0.01})
brep_brep = BrepBrep(BrepA=loft_2, BrepB=ruled_surface)  # -> Curves, Points
截面扫描_5 = 截面扫描(曲线=brep_brep.Curves, 截面宽=Slider(0.022, range=0..1), 截面长=Slider(0.162, range=0..1))

# ----
# H
list_item_6 = ListItem(List=tree_branch, Index="0", Wrap=True)

ruled_surface_2 = RuledSurface(CurveA=curve_4, CurveB=curve_3)
number_slider_3 = Slider(0.597, range=0..1)
# H
flip_curve_4 = FlipCurve(Curve=list_item_6)  # -> Curve, Flag
length_2 = Length(Curve=flip_curve_4.Curve)  # -> flatten(Length)
sort_list_2 = SortList(Keys=length_2)  # -> Keys, ValuesValuesA
negative_4 = Negative(Value=number_slider_3)
reverse_list_2 = ReverseList(List=sort_list_2.Keys)
list_item_7 = ListItem(List=reverse_list_2, Index="0", Wrap=True)
merge_4 = Merge(Data1=number_slider_3, Data2=negative_4)
offset_2 = Offset(Surface=ruled_surface_2, Distance=merge_4, Retrim=True)
subtraction = Subtraction(A=list_item_7, B=length_2)  # -> graft(Result)
extend_curve = ExtendCurve(Curve=flip_curve_4.Curve, Type=0, Start="0", End=subtraction)
loft_3 = Loft(Curves=offset_2, Options={Adjust=False, Closed=False, LoftEnds=0, LoftSimp=0, LoftType=0, Rebuild=10, Refit=0.01})
merge_5 = Merge(Data1=offset_2, Data2=loft_3)
divide_length = DivideLength(Curve=extend_curve, Length=Slider(0.765, range=0..2))  # -> Points, Tangents, Parameters
brep_join = BrepJoin(Breps=merge_5)  # -> Breps, Closed
flip_matrix = FlipMatrix(Data=divide_length.Points)
polyline_2 = PolyLine(Vertices=flip_matrix, Closed=False)
trim_with_brep = TrimWithBrep(Curve=polyline_2, Brep=brep_join.Breps)  # -> Inside, Outside
join_curves = JoinCurves(Curves=trim_with_brep.Inside, Preserve=False)
control_points = ControlPoints(Curve=join_curves)  # -> Points, Weights, Knots
polyline_3 = PolyLine(Vertices=control_points.Points, Closed=False)
截面扫描_6 = 截面扫描(曲线=polyline_3, 截面宽=Slider(0.113, range=0..1), 截面长=Slider(0.062, range=0..1))

unit_vector_3 = UnitVector(Vector=list_item_6)
# G
reverse = Reverse(Vector=unit_vector_3)
end_points_2 = EndPoints(Curve=list_item_6)  # -> Start, End
project_point = ProjectPoint(Point=end_points_2.Start, Direction=reverse, Geometry=loft)  # -> Point, Index
gate_not = GateNot(A=project_point.Index)
cull_pattern_2 = CullPattern(List=project_point.Point, CullPattern=gate_not)
cull_pattern_3 = CullPattern(List=end_points_2.Start, CullPattern=gate_not)

surface_closest_point = SurfaceClosestPoint(Point=cull_pattern_2, Surface=loft)  # -> Point, flatten(UVPoint), Distance
curve_on_surface = CurveOnSurface(Surface=loft, UVCoordinates=surface_closest_point.UVPoint, Closed=False)  # -> Curve, Length, Domain
offset_on_srf = OffsetOnSrf(Curve=curve_on_surface.Curve, Distance=Slider(0.834, range=0..1), Surface=loft)
curve_closest_point_2 = CurveClosestPoint(Point=cull_pattern_2, Curve=offset_on_srf)  # -> Point, Parameter, Distance
# I
line_3 = Line(StartPoint=curve_closest_point_2.Point, EndPoint=cull_pattern_3)
截面扫描_7 = 截面扫描(曲线=line_3, 截面宽=Slider(0.123, range=0..1), 截面长=Slider(0.046, range=0..1))

line_4 = Line(StartPoint=cull_pattern_2, EndPoint=cull_pattern_3)  # -> simplify(Line)
merge_6 = Merge(Data1=polyline, Data2=line_4)
join_curves_2 = JoinCurves(Curves=merge_6, Preserve=False)
flip_curve_5 = FlipCurve(Curve=join_curves_2)  # -> Curve, Flag
截面扫描_8 = 截面扫描(曲线=flip_curve_5.Curve, 截面宽=Slider(0.152, range=0..1), 截面长=Slider(0.076, range=0..1))
# I
collision_one_many = CollisionOneMany(Collider=截面扫描_4, Obstacles=截面扫描_8)  # -> Collision, Index
gate_not_2 = GateNot(A=collision_one_many.Collision)  # -> flatten(Result)
cull_pattern_4 = CullPattern(List=flatten(截面扫描_4), CullPattern=gate_not_2)

# ==== cluster 截面扫描
截面宽 = ClusterInput()
截面长 = ClusterInput()
曲线 = ClusterInput()
正垂直曲线参考平面 = 正垂直曲线参考平面(曲线=曲线)
negative = Negative(Value=截面宽)
negative_2 = Negative(Value=截面长)
construct_domain = ConstructDomain(DomainStart=截面长, DomainEnd=negative_2)
construct_domain_2 = ConstructDomain(DomainStart=截面宽, DomainEnd=negative)
rectangle = Rectangle(Plane=正垂直曲线参考平面, XSize=construct_domain_2, YSize=construct_domain, Radius=0)  # -> Rectangle, Length
sweep1 = Sweep1(Rail=曲线, Sections=rectangle.Rectangle, Miter=1)
cap_holes = CapHoles(Brep=sweep1)  # -> flatten(Brep)
截面扫描 = ClusterOutput(cap_holes)

# ==== cluster 正垂直曲线参考平面
曲线 = ClusterInput()
horizontal_frame = HorizontalFrame(Curve=曲线, Parameter="0")
evaluate_length = EvaluateLength(Curve=曲线, Length="0", Normalized=True)  # -> Point, Tangent, Parameter
vector_display = VectorDisplay(Anchor=evaluate_length.Point, Vector=evaluate_length.Tangent)
deconstruct_plane = DeconstructPlane(Plane=horizontal_frame)  # -> Origin, XAxis, YAxis, ZAxis
vector_display_2 = VectorDisplay(Anchor=evaluate_length.Point, Vector=deconstruct_plane.YAxis)
cross_product = CrossProduct(VectorA=evaluate_length.Tangent, VectorB=deconstruct_plane.YAxis, Unitize=False)  # -> Vector, Length
vector_display_3 = VectorDisplay(Anchor=evaluate_length.Point, Vector=cross_product.Vector)
construct_plane = ConstructPlane(Origin=evaluate_length.Point, XAxis=cross_product.Vector, YAxis=deconstruct_plane.YAxis)
正垂直曲线参考平面 = ClusterOutput(construct_plane)
